# Grasshopper definition Cyborg_example00.gh (Grasshopper 0.9.76)
# plug-ins: Cyborg

# ---- group: Base Mesh, should be triangulated
res = Slider(50, range=0..100)
crv = Curve(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)
mplane = MeshPlane(Boundary=crv, WidthCount=res, HeightCount=res)  # -> Mesh, Area
tri = Triangulate(Mesh=mplane.Mesh)  # -> Mesh, Count

# ---- group: Create Fields
pt = Point([Point(86.81492335, 87.45841978, 0), Point(130.0273606, 87.45841978, 0), Point(130.0273606, 128.7417303, 0), Point(86.81492335, 128.7417303, 0)])
crv_2 = Curve([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])
pt_2 = Point([Point(166.8465833, 109.07029, 0), Point(49.73905339, 107.4167156, 0), Point(108.8001926, 53.19541733, 0), Point(108.8001926, 158.4579299, 0)])
mfield = MeshField(BaseMesh=tri.Mesh, DrawingInput=crv_2, IsoValue=Slider(-0.9, range=-1..1))
mfield_2 = MeshField(BaseMesh=tri.Mesh, DrawingInput=pt, IsoValue=Slider(-0.439, range=-1..1))
mfield_3 = MeshField(BaseMesh=tri.Mesh, DrawingInput=pt_2, IsoValue=Slider(-0.5, range=-1..1))

# ---- group: Field Operations
uni = Union(Field0=mfield_3, Field1=mfield)

# ---- group: Blend
number_slider = Slider(15, range=0..50)
division = Division(A=1, B=number_slider)
series = Series(Start=0, Step=division, Count=number_slider)
ins = InsertItems(List=series, Item=1, Indices=-1, Wrap=True)
fblend = BlendFields(BaseMesh=tri.Mesh, Field0=uni, Field1=mfield_2, BlendParameters=ins)

# ---- group: Create Mesh Slices
mesh = Mesh(tri.Mesh)
series_2 = Series(Start=0, Step=Slider(13.8, range=0..20), Count=expr("x+1", number_slider))
Z = UnitZ(Factor=series_2)
move = Move(Geometry=mesh, Motion=Z)  # -> Geometry, Transform

# ---- group: Display
swatch = ColourSwatch(SwatchColor=RGB(255, 255, 255))
merge = Merge(
    Data1=ColourSwatch(SwatchColor=RGB(255, 0, 115)),
    Data2=ColourSwatch(SwatchColor=RGB(0, 0, 0)),
    Data3=swatch,
    Data4=swatch,
    Data5=swatch)
fdisp = FieldDisplay(Mesh=move.Geometry, Field=fblend, Colors=merge)
isocon = IsoContour(Mesh=move.Geometry, Field=fblend)
